# Grasshopper definition PSL_TracerABC_example.gh (Grasshopper 1.0.8)
# plug-ins: Karamba3D, Pufferfish, eleFront

crv = Curve(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)
boundary = BoundarySurfaces(Edges=crv)
mesh_uv = MeshSurface(Surface=boundary, UCount="80", VCount="80", Overhang=True, Equalize=False)
crv_2 = Curve(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)
explode = Explode(Curve=crv_2, Recursive=True)  # -> Segments, Vertices
boundary_2 = BoundarySurfaces(Edges=crv_2)
disc = Discontinuity(Curve=crv_2, Level=1)  # -> Points, Parameters

medges = MeshEdges(Mesh=mesh_uv)  # -> NakedEdges, InteriorEdges, NonManifoldEdges
nv = NakedVertices(Mesh=mesh_uv)  # -> ClothedIndex, NakedIndex, ClothedPts, NakedPts
vertexloads = VertexLoads(Mesh=mesh_uv, Strength="-0.0000001")
crv_3 = Curve(medges.InteriorEdges)
anchor = Anchor(Point=nv.NakedPts, Strength=10000)
len = Length(Curve=crv_3)
show = Show(G=mesh_uv)
multiplication = Multiplication(A=len, B=Slider(0.27, range=0..0.9))
length_line = LengthLine(Line=crv_3, Length=multiplication, Strength=10)
entwine = Entwine(Branch00=show, Branch01=length_line, Branch02=anchor, Branch03=vertexloads, FlattenInputs=True)

midpt = CurveMiddle(Curve=explode.Segments)
mesh_uv_2 = MeshSurface(Surface=boundary_2, UCount="80", VCount="80", Overhang=True, Equalize=False)
crv_cp = CurveClosestPoint(Point=midpt, Curve=explode.Segments)  # -> Point, Parameter, Distance
shatter = Shatter(Curve=explode.Segments, Parameters=crv_cp.Parameter)
item = ListItem(List=shatter, Index=0, Wrap=True)

medges_2 = MeshEdges(Mesh=mesh_uv_2)  # -> NakedEdges, InteriorEdges, NonManifoldEdges
nv_2 = NakedVertices(Mesh=mesh_uv_2)  # -> ClothedIndex, NakedIndex, ClothedPts, NakedPts
vertexloads_2 = VertexLoads(Mesh=mesh_uv_2, Strength="-0.1")
crv_4 = Curve(medges_2.InteriorEdges)
anchor_2 = Anchor(Point=nv_2.NakedPts, Strength=10000)
len_2 = Length(Curve=crv_4)
show_2 = Show(G=mesh_uv_2)
multiplication_2 = Multiplication(A=len_2, B=Slider(0.27, range=0..0.9))
length_line_2 = LengthLine(Line=crv_4, Length=multiplication_2, Strength=10)
entwine_2 = Entwine(Branch00=show_2, Branch01=length_line_2, Branch02=anchor_2, Branch03=vertexloads_2, FlattenInputs=True)

divlength = DivideLength(Curve=item, Length="5")  # -> Points, Tangents, Parameters
solver = Solver(GoalObjects=entwine, Reset=Button(), Threshold=1e-15, Tolerance=0.0001, On=Toggle(False))  # -> I, V, O
formfound_mesh = ExplodeTree(Data=solver.O)
dam = DataDam(DataA=formfound_mesh, BufferDelay=10000000, BufferMode=0)
solver_2 = Solver(GoalObjects=entwine_2, Reset=Button(), Threshold=1e-15, Tolerance=0.0001, On=Toggle(False))  # -> I, V, O
formfound_mesh_2 = ExplodeTree(Data=solver_2.O)
dam_2 = DataDam(DataA=formfound_mesh_2, BufferDelay=10000000, BufferMode=0)
mesh = Mesh(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)
mesh_2 = Mesh(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)

number_slider = Slider(-2, range=-10..0)
nv_3 = NakedVertices(Mesh=mesh)  # -> ClothedIndex, NakedIndex, ClothedPts, NakedPts
Z = UnitZ(Factor="-0.1")
matprops = MaterialPropertiesKaramba3D(
    FamilyOfMaterial="Steel",
    Name="S235",
    YoungsModulus_kN_cm²="3",
    InPlaneShearModulus_kN_cm²="1.4",
    TransverseShearModulus_kN_cm²="1.4",
    SpecificWeight_kN_m³="1",
    CoefficientOfThermalExpansion_1=1.2e-05,
    TensileStrength_kN_cm²=23.5,
    CompressiveStrength_kN_cm²=-23.5,
    StrengthHypothesis="MISES",
    mode="Isotrop")
supp = SupportKaramba3D(PosInd=nv_3.NakedPts, Ct_kN_m=Vector(0, 0, 0), Cr_kNm_rad=Vector(0, 0, 0), menu=[buttons(on, on, on, off, off, off)])
loads = LoadsKaramba3D(Vector=Z, Mesh=mesh, LCase="LC0", mode="MeshLoad -Const.", menu=[buttons(off, on, off), buttons(on, on)])
loads_2 = LoadsKaramba3D(Eps0="-2", LCase="LC0", mode="InitialStrain")
crosec = CrossSectionKaramba3D(FamilyNameOfCrossSection="DefaultCroSec", Material=matprops, Height_cm="0.3", mode="Shell - Const")
load = LoadKaramba3D([loads, loads_2])
surfelem = CreateSurfaceElementKaramba3D(Mesh=mesh, CrossSection=crosec, LimitDistance_m=0.005, Bending=False, mode="MeshToMembrane")  # -> Element, Points, Info
assemble = AssembleModelKaramba3D(Elem=flatten(surfelem.Element), Support=flatten(supp), Load=flatten(load), LimitDistance_cm=0.005)  # -> Model, Info, Mass_kg, CentreOfGravity, LoadCaseNames

nv_4 = NakedVertices(Mesh=mesh_2)  # -> ClothedIndex, NakedIndex, ClothedPts, NakedPts
Z_2 = UnitZ(Factor=Slider(-2, range=-10..0))
matprops_2 = MaterialPropertiesKaramba3D(
    FamilyOfMaterial="Steel",
    Name="S235",
    YoungsModulus_kN_cm²="3",
    InPlaneShearModulus_kN_cm²="1.4",
    TransverseShearModulus_kN_cm²="1.4",
    SpecificWeight_kN_m³="1",
    CoefficientOfThermalExpansion_1=1.2e-05,
    TensileStrength_kN_cm²=23.5,
    CompressiveStrength_kN_cm²=-23.5,
    StrengthHypothesis="MISES",
    mode="Isotrop")
supp_2 = SupportKaramba3D(PosInd=nv_4.NakedPts, Ct_kN_m=Vector(0, 0, 0), Cr_kNm_rad=Vector(0, 0, 0), menu=[buttons(on, on, on, off, off, off)])
loads_3 = LoadsKaramba3D(Vector=Z_2, Mesh=mesh_2, LCase="LC0", mode="MeshLoad -Const.", menu=[buttons(off, on, off), buttons(on, on)])
loads_4 = LoadsKaramba3D(Eps0="-2", LCase="LC0", mode="InitialStrain")
crosec_2 = CrossSectionKaramba3D(FamilyNameOfCrossSection="DefaultCroSec", Material=matprops_2, Height_cm="0.3", mode="Shell - Const")
load_2 = LoadKaramba3D([loads_3, loads_4])
surfelem_2 = CreateSurfaceElementKaramba3D(Mesh=mesh_2, CrossSection=crosec_2, LimitDistance_m=0.005, Bending=False, mode="MeshToMembrane")  # -> Element, Points, Info
assemble_2 = AssembleModelKaramba3D(Elem=flatten(surfelem_2.Element), Support=flatten(supp_2), Load=flatten(load_2), LimitDistance_cm=0.005)  # -> Model, Info, Mass_kg, CentreOfGravity, LoadCaseNames

panel = Panel("-0.1")
analysethii = AnalyseThIIKaramba3D(
    Model=assemble.Model,
    UseInitialNII=True,
    NIIFromCombination=True,
    NoTensionalNII=False,
    RTolerance=1e-07,
    MaxIterations=50)  # -> AnalysedModel, MaximumDisplacement_cm, ResultingForce_kN, ChangeOfElasticEnergy_kNm
analysethii_2 = AnalyseThIIKaramba3D(
    Model=assemble_2.Model,
    UseInitialNII=True,
    NIIFromCombination=True,
    NoTensionalNII=False,
    RTolerance=1e-07,
    MaxIterations=50)  # -> AnalysedModel, MaximumDisplacement_cm, ResultingForce_kN, ChangeOfElasticEnergy_kNm
modelview = ModelViewKaramba3D(Model=analysethii.AnalysedModel)  # -> Model, DeformedMesh, DeformedAxes, DeformedModel, MaximumDeformation
shellview = ShellViewKaramba3D(Model=analysethii.AnalysedModel, IndexOfLayer=0)  # -> Model, MeshesOfRenderedShells, LegendColours, LegendTags
shellvecresults = ResultVectorsOnShellsKaramba3D(Model=analysethii_2.AnalysedModel, LayerPosition=0, mode="PrincStress")  # -> Model, Points, FirstPrincipalStressVector_kN_cm², SecondPrincipalStressVector_kN_cm², FirstPrincipalStressValue_kN_cm², SecondPrincipalStressValue_kN_cm²
s_forces = ShellForcesKaramba3D(AnalysedModel=analysethii_2.AnalysedModel, mode="Principal")  # -> Model, expr("x*100", flatten(FirstPrincipalNormalForce_kN_m)), expr("x*100", flatten(SecondPrincipalNormalForce_kN_m)), FirstPrincipalMoment_kNm_m, SecondPrincipalMoment_kNm_m, ShearForceInLocalXDirection_kN_m, ShearForceInLocalYDirection_kN_m, LoadCaseIndex
modelview_2 = ModelViewKaramba3D(Model=analysethii_2.AnalysedModel)  # -> Model, DeformedMesh, DeformedAxes, DeformedModel, MaximumDeformation
shellview_2 = ShellViewKaramba3D(Model=analysethii_2.AnalysedModel, IndexOfLayer=0)  # -> Model, MeshesOfRenderedShells, LegendColours, LegendTags
legend = Legend(
    Colour=shellview.LegendColours,
    Tags=shellview.LegendTags,
    Rectangle={Plane=PlaneXY(346, 100, 0), Size=Domain2(u=-25..25, v=-100..100)},
    LegendType=1)
textdot = DefineTextDot(Text=s_forces.FirstPrincipalNormalForce_kN_m, Location=shellvecresults.Points, Font="Arial", Size=9)
bnd = Bounds(Numbers=s_forces.FirstPrincipalNormalForce_kN_m)
legend_2 = Legend(
    Colour=shellview_2.LegendColours,
    Tags=shellview_2.LegendTags,
    Rectangle={Plane=PlaneXY(70, -35, 0), Size=Domain2(u=-7..7, v=-30..30)},
    LegendType=1)
shellvecresults_2 = ResultVectorsOnShellsKaramba3D(Model=analysethii.AnalysedModel, LayerPosition=0, mode="PrincStress")  # -> Model, Points, FirstPrincipalStressVector_kN_cm², SecondPrincipalStressVector_kN_cm², FirstPrincipalStressValue_kN_cm², SecondPrincipalStressValue_kN_cm²
md_slider = MDSlider(
    SliderMode=0,
    slider_value=Point(0.05455947504, 0.0690794999, 0.5),
    x_domain=Domain(0, 1),
    y_domain=Domain(0, 1),
    z_domain=Domain(0, 1))
mesh_3 = Mesh(mesh)
area = Area(Geometry=boundary)  # -> Area, Centroid
debrep = DeconstructBrep(Brep=boundary)  # -> Faces, Edges, Vertices
msh2psrf = MeshToPolysurface(Mesh=mesh_3, Triangles=False, FaceMerge=False)
midpt_2 = CurveMiddle(Curve=debrep.Edges)
mesh_4 = Mesh(mesh_2)
md_slider_2 = MDSlider(
    SliderMode=0,
    slider_value=Point(0.05573849562, 0.4963306799, 0.5),
    x_domain=Domain(0, 1),
    y_domain=Domain(0, 1),
    z_domain=Domain(0, 1))
evalsrf = EvaluateSurface(Surface=reparameterize(msh2psrf), Point=md_slider)  # -> Point, Normal, UDirection, VDirection, Frame
ln = Line(StartPoint=area.Centroid, EndPoint=midpt_2)
msh2psrf_2 = MeshToPolysurface(Mesh=mesh_4, Triangles=False, FaceMerge=False)
divide = DivideCurve(Curve=ln, Count=10, Kinks=False)  # -> Points, Tangents, Parameters
project = ProjectPoint(Point=evalsrf.Point, Direction=Vector(0, 0, -1), Geometry=msh2psrf)  # -> Point, Index
evalsrf_2 = EvaluateSurface(Surface=reparameterize(msh2psrf_2), Point=md_slider_2)  # -> Point, Normal, UDirection, VDirection, Frame
cull_i = CullIndex(List=divide.Points, Indices=[0, -1], Wrap=True)
crv_5 = Curve(crv)
project_2 = ProjectPoint(Point=evalsrf_2.Point, Direction=Vector(0, 0, -1), Geometry=msh2psrf_2)  # -> Point, Index
explode_2 = Explode(Curve=crv_5, Recursive=True)  # -> Segments, Vertices
crv_6 = Curve(crv_2)
explode_3 = Explode(Curve=crv_6, Recursive=True)  # -> Segments, Vertices

tracer_b = Python3Script(
    seed_point=project.Point,
    principal_vectors=shellvecresults_2.SecondPrincipalStressVector_kN_cm²,
    points=shellvecresults_2.Points,
    domain_surface=msh2psrf,
    boundary_curves=explode_2.Segments)  # -> psl, connect, valid_seeds; inputs seed_point: Point3d, principal_vectors: list of Vector3d, points: list of Point3d, domain_surface: Brep, boundary_curves: list of Curve
# ---------- tracer_b: Python ----------
from PSL_Tracer import Tracer_B


#BASIC
h = 0.4                         #Step length
num_steps = 1000                #Max iterations
k = 15                          #Interpolation amount
collision_threshold = 1.5       #Distance constraint
snap_radius = 1                 #Snapping radius
n_back = 5                      #Steps back when merging
offset_distance = 3             #Offset distance
sample_interval = 2             #Sampling for offsets

sample_count = 300              #Sampling boundaries for edge connection 
k_edge = 30                     #Edge connection considerations
ratio_minseed_coll = 1.5        #Ratio between min_seed_distance and collision_threshold   min_seed_distance = collision_threshold * ratio




psl, connect, valid_seeds= Tracer_B.main(h,num_steps,k,collision_threshold,snap_radius,n_back,offset_distance,sample_interval,sample_count,k_edge,ratio_minseed_coll,seed_point,principal_vectors,points,domain_surface,boundary_curves)
# ---------- end tracer_b ----------
tracer_a = Python3Script(
    seed_points=flatten(cull_i),
    principal_vectors=shellvecresults_2.SecondPrincipalStressVector_kN_cm²,
    points=shellvecresults_2.Points,
    domain_surface=msh2psrf,
    boundary_curves=explode_2.Segments)  # -> a, b; inputs seed_points: list of Point3d, principal_vectors: list of Vector3d, points: list of Point3d, domain_surface: Brep, boundary_curves: list of Curve
# ---------- tracer_a: Python ----------
from PSL_Tracer import Tracer_A

#Variables
h = 0.5                     #step length
num_steps=400               #Max Iterations
k=15                        #k nearest neighbours for interpolation
collision_threshold=1       #distance constraint
merge_radius = 5            #snapping radius
n_back = 5                  #Steps back when merging
sample_count = 500          #Sampling boundaries for edge connection
k_edge = 30                 #edge connection considerations



a,b = Tracer_A.main(h,num_steps,k,collision_threshold,merge_radius,n_back,sample_count,k_edge,seed_points,principal_vectors,points,domain_surface,boundary_curves)
# ---------- end tracer_a ----------
tracer_c = Python3Script(
    seed_point=project_2.Point,
    principal_vectors=shellvecresults.FirstPrincipalStressVector_kN_cm²,
    points=shellvecresults.Points,
    domain_surface=msh2psrf_2,
    boundary_curves=explode_3.Segments,
    stress_values=s_forces.FirstPrincipalNormalForce_kN_m)  # -> a, b, c; inputs seed_point: list of Point3d, principal_vectors: list of Vector3d, points: list of Point3d, domain_surface: Brep, boundary_curves: list of Curve, stress_values: list of Double
# ---------- tracer_c: Python ----------
# variables
h = 0.4
num_steps = 1000
k = 15
collision_threshold = 1.0
max_offset_distance = 8
n_back = 5
strength = 250
snap_radius = 1
sample_count = 300
ratio_minseed_coll = 1.5
sample_interval = 2



from PSL_Tracer import Tracer_C



a, b ,c = Tracer_C.main(ghenv,h,num_steps,k,collision_threshold,snap_radius,n_back,max_offset_distance,sample_interval,sample_count,ratio_minseed_coll,seed_point,principal_vectors,points,domain_surface,boundary_curves,strength,stress_values)
# ---------- end tracer_c ----------
